# Grasshopper definition Test for ArchiVision.gh (Grasshopper 1.0.7)
# plug-ins: ArchiVision

mbox = MeshBox(Base={Plane=PlaneXY(0, 0, 0), X=Domain(-10, 10), Y=Domain(-10, 10), Z=Domain(-10, 10)}, XCount=10, YCount=10, ZCount=10)
nickname = CurveDisplayAttribute(Colour=RGB(214, 15, 15), Thickness=2, LineType=-1, Absolute=True, TopMost=False)
nickname_2 = CurveRenderItemAttributeComponent(Colour=RGB(230, 53, 53), Thickness=2, LineType=1, Absolute=True, TopMost=True)
crv = Curve(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)
nickname_3 = CurveRenderItemAttributeComponent(Colour=RGB(230, 53, 53), Thickness=Slider(1, range=0..10), LineType=0, Absolute=False, TopMost=False)
rectangle = Rectangle(Plane=PlaneXY(0, 0, 0), XSize=Domain(-1, 1), YSize=Domain(-2, 2), Radius=0)  # -> Rectangle, Length
crv_ri = CurveRenderItem(Curve=crv, CurveRenderAttribute=nickname_2, StartArrow=True, EndArrow=True, ArrowMult=10)
c_script = CSharpScript(X=rectangle.Rectangle)  # -> Out, A
s_ri = ShaderRenderItem(
    Mesh=mbox,
    Material={diffuse=RGB(255, 255, 255), emission=RGB(76, 76, 76), shine=0.5, specular=RGB(255, 255, 255), transparency=0},
    AngleLimit=0.5235987756,
    NakedEdgeAttribute=nickname_2,
    InteriorEdgeAttribute=nickname_3,
    OutLineAttribute=nickname)
ri = RenderItem(crv_ri)
ri_2 = RenderItem(s_ri)
